# Grasshopper definition ExportTest.gh (Grasshopper 1.0.7)
# plug-ins: LineCDL, Shachihoko

number_slider = Slider(10, range=0..10)
number_slider_2 = Slider(10, range=0..10)
center_box = CenterBox(Base=PlaneXY(0, 0, 0), X=Slider(6, range=0..10), Y=Slider(2.5, range=0..10), Z=number_slider)
unit_z = UnitZ(Factor=1)
line_cdl = LineCDL(Center=Point(0, 0, 0), Direction=unit_z, Length=expr("x*2", number_slider))
mesh_box = MeshBox(Base=center_box, XCount=number_slider_2, YCount=number_slider_2, ZCount=10)
materialparam = MaterialParam(ParamType=0)
twist = Twist(Geometry=mesh_box, Axis=line_cdl, Angle=1.570796327, Infinite=False, Rigid=False)
material = Material(ShaderType=0)
export = Export(Mesh=twist, FolderPath="D:\デスクトップ", FileName="model", Switch=Toggle(False))
